# Grasshopper definition Facade_Storefront & Mullions 0.2.0.gh (Grasshopper 1.0.7)

input = DataInput(
    Destination="C:\Users\Brooks Scarpa\Desktop\walls.ghdata",
    RelativePath="C:\Users\Brooks Scarpa\Desktop\walls.ghdata|..\..\..\..\..\..\Desktop\walls.ghdata",
    UpdateDelay=5)

# ---- group: Base Surface
# REGULATED SPACING
base_surface = Geometry(graft(input))

# ---- group: Distance Between Verticals
spacing = Slider(4, range=0..60)

# ----
create_mullions = CreateMullions(L=spacing, B=base_surface)

# ==== cluster CreateMullions
B = ClusterInput()

edges = BrepEdges(Brep=B)  # -> Naked, Interior, NonManifold
curvepoint = PointOnCurve(edges.Naked, parameter=0.5)
pdecon = Deconstruct(Point=curvepoint)  # -> XComponent, YComponent, ZComponent
sort = SortList(Keys=pdecon.ZComponent, ValuesA=edges.Naked)  # -> Keys, ValuesA
item = ListItem(List=reverse(sort.ValuesA), Index=0, Wrap=True)  # -> Item, Item1, Item2, Item3

flip = FlipCurve(Curve=item.Item3)  # -> Curve, Flag
crv = Curve(item.Item)
crv_2 = Curve(item.Item3)

L = ClusterInput()
divlength = DivideLength(Curve=item.Item, Length=L)  # -> Points, Tangents, Parameters
lng = ListLength(List=divlength.Points)  # -> simplify(Length)
divide = DivideCurve(Curve=reparameterize(simplify(crv_2)), Count=lng, Kinks=False)  # -> Points, Tangents, Parameters
crv_cp = CurveClosestPoint(Point=divide.Points, Curve=crv)  # -> Point, Parameter, Distance
ln = Line(StartPoint=crv_cp.Point, EndPoint=divide.Points)
L_2 = ClusterOutput(ln)
