# Grasshopper definition BSA_RhinoToRevit_DirectShape 0.3.0.gh (Grasshopper 1.0.7)
# plug-ins: Rhino.Inside for Autodesk Revit

categories = DirectShapeCategories("autodesk.revit.category.family:curtainWallPanels-1.0.0", SearchPattern="curtain wall")
brep = Brep([<brep referenced from the Rhino model> x1008])

# ---- group: Material Color Selection
swatch = ColourSwatch(SwatchColor=RGB(192, 180, 146))

# ----
dam = DataDam(DataA=brep, BufferDelay=10000000, BufferMode=0)
material = AddMaterial(Name="Example Material #1", TrackingMode=2)
graphics = MaterialGraphics(Material=material, Color=swatch)  # -> Material, UseRenderAppearance, Color, Transparency, SurfacePatternsForegroundPattern, SurfacePatternsForegroundColor, CutPatternsForegroundPattern, CutPatternsForegroundColor
g_shape = AddGeometryDirectShape(Category=categories, Geometry=dam, Material=graphics.Material, TrackingMode=2)
