# Grasshopper definition BuildingElements_Railings 0.1.0.gh (Grasshopper 1.0.8)

crv = Curve(<curve referenced from the Rhino model>)
picketrailing = GhPythonScript(crv=crv)  # -> sill_curve, pickets, head_curve; inputs crv: Curve
# ---------- picketrailing: Python ----------
__author__ = "ilouh"
__version__ = "2023.02.21"

import rhinoscriptsyntax as rs
import Grasshopper as gh
import Rhino.Geometry as rg
import ghpythonlib.components as comps
import math


crvs = comps.Explode(crv,True)['segments']

pickets = []

sill_curve = crv 
head_curve = comps.Move(crv,comps.UnitZ(42))['geometry']

for crv in crvs: 
    
    points = len(comps.DivideLength(crv,4)['points'])
    points = comps.DivideCurve(crv,points,kinks = False)['points']
    
    for point in points:
        

        line = comps.LineSDL(point,comps.UnitZ(1),42)
        pickets.append(line)
# ---------- end picketrailing ----------
railing = Curve([picketrailing.pickets, picketrailing.head_curve, picketrailing.sill_curve])
