# Grasshopper definition BuildingElements_WindowsFromCurves.gh (Grasshopper 1.0.8)

pipeline = GeometryPipeline(
    GroupByLayer=False,
    GroupByType=False,
    IncludeHidden=True,
    IncludeLocked=True,
    LayerFilter="03_ARCH*03_WINDOW_FRAME",
    NameFilter="*",
    SublayerFiltering=True,
    TypeFilter=4)
boundary_curve = Curve(graft(pipeline))
framewidth = Slider(2, range=0..2)
framedepth = Slider(2, range=0..5)
surfaceboundary = GhPythonScript(curve=boundary_curve, distance=framewidth, frameDepth=framedepth)  # -> windowFrame, windowGlazing; inputs curve: Curve
# ---------- surfaceboundary: Python ----------
__author__ = "ilouh"
__version__ = "2023.02.21"

import rhinoscriptsyntax as rs
import Grasshopper as gh
import Rhino.Geometry as rg
import ghpythonlib.components as comps
import math


def createFrame(crv,distance,frameDepth):
    
    offset_1 = comps.OffsetCurve(crv,distance,corners = 1)
    offset_2 = comps.OffsetCurve(crv,-distance,corners = 1)
    
    if comps.Length(offset_1) > comps.Length(offset_2): 
        srf = comps.BoundarySurfaces([crv,offset_2])
        point = comps.ConstructPoint(0.5,0.5,0)
        normal = comps.EvaluateSurface(srf,point)['normal']
        brep = comps.Extrude(srf,comps.Amplitude(normal,frameDepth))
        brep = comps.Move(brep,comps.Amplitude(normal,-frameDepth/2))['geometry']
        return brep,comps.BoundarySurfaces(offset_2)

    
    else:
        srf =  comps.BoundarySurfaces([crv,offset_1])
        point = comps.ConstructPoint(0.5,0.5,0)
        normal = comps.EvaluateSurface(srf,point)['normal']
        brep = comps.Extrude(srf,comps.Amplitude(normal,frameDepth))
        brep = comps.Move(brep,comps.Amplitude(normal,-frameDepth/2))['geometry']
        return brep,comps.BoundarySurfaces(offset_1)



windowFrame = createFrame(curve,distance,frameDepth)[0]
windowGlazing = createFrame(curve,distance,frameDepth)[1]
# ---------- end surfaceboundary ----------
frame = Brep(surfaceboundary.windowFrame)
glazing = Surface(surfaceboundary.windowGlazing)
preview = CustomPreview(Geometry=frame, Material=ColourSwatch(SwatchColor=RGB(70, 19, 17)))
preview_2 = CustomPreview(Geometry=glazing, Material=ColourSwatch(SwatchColor=RGBA(255, 0, 255, 59)))
