# Grasshopper definition Radiation Rose.gh (Grasshopper 1.0.8)

ladybug = Ladybug_Ladybug()  # -> Vviiiiiiiiiizzz; plug-in component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
# Go to ladybug.tools/epwmap/ to select location. Copy link to clipboard and past it in the text box above.
panel = Panel("http://climate.onebuilding.org/WMO_Region_4_North_and_Central_America/California_Climate_Zones/California_CTZ_2010/USA_CA_Los.Angeles.Intl.AP.722950_CTZ2010.zip")

# ---- group: Setup North Arrow
north_arrow_head = Point(<point referenced from the Rhino model>)
north_arrow_tail = Point(<point referenced from the Rhino model>)
vec2pt = Vector2Pt(PointA=north_arrow_tail, PointB=north_arrow_head, Unitize=False)  # -> Vector, Length

# ----
epw_stat = Ladybug_OpenEPWAndSTATWeatherFiles(weatherFileURL=panel)  # -> epwFile, statFile; plug-in component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
gencumulativeskymtx = Ladybug_GenCumulativeSkyMtx(epwFile=epw_stat.epwFile, skyDensity=0, useOldRes=True, runIt=Toggle(True))  # -> readMe, cumulativeSkyMtx; plug-in component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
pt = Point(<point referenced from the Rhino model>)
selectskymtx = Ladybug_selectSkyMtx(cumulativeSkyMtx=gencumulativeskymtx.cumulativeSkyMtx, removeDiffuse=False, removeDirect=False)  # -> readMe, selectedSkyMtx; plug-in component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
radiationrose = Ladybug_RadiationRose(
    north=vec2pt.Vector,
    selectedSkyMtx=selectskymtx.selectedSkyMtx,
    numOfArrows="24",
    centerPoint=pt,
    scale=Slider(0.1, range=0..100),
    arrowHeadScale="3",
    showTotalOnly=Toggle(True),
    runIt=Toggle(True))  # -> readMe, radiationArrowsMesh, radRoseBaseCrvs, legend, legendBasePts, radRoseEndPts, radRoseValues; plug-in component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
