# Grasshopper definition Shadow Range.gh (Grasshopper 1.0.7)

# Go to ladybug.tools/epwmap/ to select location. Copy link to clipboard and past it in the text box above.
panel = Panel("http://climate.onebuilding.org/WMO_Region_4_North_and_Central_America/California_Climate_Zones/California_CTZ_2010/USA_CA_Los.Angeles.Intl.AP.722950_CTZ2010.zip")
ladybug = Ladybug_Ladybug()  # -> Vviiiiiiiiiizzz; plug-in component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

# ---- group: Input Geometry
brep = Brep([<brep referenced from the Rhino model> x2404])

# ---- group: Set your Base Plane
geo = Geometry(<brep referenced from the Rhino model>)

# ----
epw_stat = Ladybug_OpenEPWAndSTATWeatherFiles(weatherFileURL=panel)  # -> epwFile, statFile; plug-in component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

# ---- group: Create Geometry Center Point
bbox = BoundingBox(Content=brep, Plane=PlaneXY(0, 0, 0), UnionBox=True)  # -> Box, Box_2
volume = Volume(Geometry=bbox.Box)  # -> Volume, Centroid
pdecon = Deconstruct(Point=volume.Centroid)  # -> XComponent, YComponent, ZComponent
pt = ConstructPoint(XCoordinate=pdecon.XComponent, YCoordinate=pdecon.YComponent, ZCoordinate=0)

# ----
importlocation = Ladybug_ImportLocation(epwFile=epw_stat.epwFile)  # -> location; plug-in component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
series = Series(Start="8", Step=1, Count="11")
sunpath = Ladybug_SunPath(
    location=importlocation,
    hour=series,
    day=21,
    month="9",
    timeStep=1,
    centerPt=pt,
    sunPathScale="0.35",
    dailyOrAnnualSunPath=True)  # -> readMe, sunVectors, sunAltitudes, sunAzimuths, port, sunSpheresMesh, sunPathCrvs, compassCrvs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; plug-in component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
panel_2 = Panel(sunpath.readMe)
mesh = Mesh(sunpath.sunSpheresMesh)
path = FilePath("C:\Users\Brooks Scarpa\Desktop\Junk\")
gradientlibrary = Ladybug_GradientLibrary(gradIndex="5")  # -> customColors; plug-in component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
toggle = BooleanToggle(True)
legendpar = Ladybug_LegendParameters(customColors=flatten(gradientlibrary))  # -> legendPar; plug-in component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
sunlighthoursanalysis = Ladybug_SunlightHoursAnalysis(
    geometry=flatten(geo),
    context=flatten(brep),
    gridSize="24",
    disFromBase="2",
    sunVectors=flatten(sunpath.sunVectors),
    timeStep=1,
    legendPar=flatten(legendpar),
    parallel=toggle,
    runIt=toggle,
    bakeIt=Toggle(False),
    workingDir=path)  # -> readMe, contextMesh, analysisMesh, testPts, testVec, port, sunlightHoursResult, sunlightHoursMesh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; plug-in component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
preview = CustomPreview(Geometry=[sunpath.sunPathCrvs, sunpath.compassCrvs], Shader=ColourSwatch(SwatchColor=RGB(192, 192, 192)))
panel_3 = Panel(sunlighthoursanalysis.readMe)
captureview = Ladybug_CaptureView()  # -> imagePath; disabled; plug-in component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
