# Grasshopper definition Sun Study 0.1.0.gh (Grasshopper 1.0.8)

# Go to ladybug.tools/epwmap/ to select location. Copy link to clipboard and past it in the text box above.
panel = Panel("https://climate.onebuilding.org/WMO_Region_4_North_and_Central_America/USA_United_States_of_America/CA_California/USA_CA_Marina.Del.Rey-Hughes.Heli.722913_TMYx.zip")

# ---- group: Input Geometry
massing_to_analyze = Brep([<brep referenced from the Rhino model> x3])

# ---- group: Set your Base Plane
ground_plane = Geometry(<surface referenced from the Rhino model>)

# ----
start = Point(Point(-67.36735877, -59.09568387, 0))
end = Point(Point(-18.22637091, -47.62045318, 0))

# ---- group: North Arrow
vec2pt = Vector2Pt(PointA=start, PointB=end, Unitize=False)  # -> Vector, Length

# ----
ladybug = Ladybug_Ladybug()  # -> Vviiiiiiiiiizzz; plug-in component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
geo = Geometry([massing_to_analyze, ground_plane])
epw_stat = Ladybug_OpenEPWAndSTATWeatherFiles(weatherFileURL=panel)  # -> epwFile, statFile; plug-in component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

# ---- group: Create Geometry Center Point
bbox = BoundingBox(Content=geo, Plane=PlaneXY(0, 0, 0), UnionBox=True)  # -> Box, Box_2
volume = Volume(Geometry=bbox.Box)  # -> Volume, Centroid
pdecon = Deconstruct(Point=volume.Centroid)  # -> XComponent, YComponent, ZComponent
pt = ConstructPoint(XCoordinate=pdecon.XComponent, YCoordinate=pdecon.YComponent, ZCoordinate=0)

# ----
importlocation = Ladybug_ImportLocation(epwFile=epw_stat.epwFile)  # -> location; plug-in component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
series = Series(Start="8", Step=1, Count="11")
panel_2 = Panel("0.1")
sunpath = Ladybug_SunPath(
    north=vec2pt.Vector,
    location=importlocation,
    hour=series,
    day=21,
    month="12",
    timeStep=1,
    centerPt=pt,
    sunPathScale=Slider(0.1, range=0..10),
    sunScale=Slider(2, range=0..10),
    dailyOrAnnualSunPath=True)  # -> readMe, sunVectors, sunAltitudes, sunAzimuths, port, sunSpheresMesh, sunPathCrvs, compassCrvs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; plug-in component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

number_slider = Slider(3, range=0..25)
colrange = LBColorRange(index=number_slider)  # -> colors; plug-in component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
legendpar = LBLegendParameters(colors=colrange)  # -> leg_par; plug-in component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

panel_3 = Panel(sunpath.readMe)
mesh = Mesh(sunpath.sunSpheresMesh)
colrange_2 = LBColorRange(index=number_slider)  # -> colors; plug-in component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
preview = CustomPreview(Geometry=[sunpath.sunPathCrvs, sunpath.compassCrvs], Shader=ColourSwatch(SwatchColor=RGB(192, 192, 192)))
directsunhours = LBDirectSunHours(
    vectors=flatten(sunpath.sunVectors),
    timestep=Slider(1, range=0..100),
    geometry=flatten(geo),
    context=flatten(ground_plane),
    grid_size=Slider(1, range=0..100),
    offset_dist=Slider(0.1, range=0..10),
    legend_par=legendpar,
    run=Toggle(True))  # -> report, points, results, mesh, legend, title, int_mtx; plug-in component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
